% Simulink data dictionary dft_filter_dic.sldd

INJ_FREQ = Simulink.Parameter(1, StorageClass="Define", DataType="single", Unit="Hz")
SAMP_FREQ = Simulink.Parameter(1000, StorageClass="Define", DataType="single", Unit="Hz")
INJ_SAMPNUM = Simulink.Parameter(1000, StorageClass="Define", DataType="uint16", Unit="NA")